# Dynamo graph Auto Door Schedules.dyn (Dynamo 2.6.1.8786)
# packages: Genius Loci 2021.1.12, archi-lab.net 2020.23.13, Rhythm 2022.9.1, BumbleBee 2021.25.3

views = Views("000_TEST")
code_block = CodeBlock { 3; }
sequence = Sequence(step=code_block)
byCoordinates = Point.ByCoordinates(x=sequence)
create_legend_component = Custom[Create Legend Component](view=views, location=byCoordinates)  # package Genius Loci; Inserts a new legend component by duplicating an existing in the given legend view. Please note : At least one legend component must be placed in the legend view.; unwired: familyType
family_types = FamilyTypes("SABER_Glass Door_00:800 x 2400")
categories = Categories("OST_Doors")
all_elements_of_category = ElementsOfCategory(Category=categories)
watch = Watch(all_elements_of_category)
select_model_elements = DSModelElementsSelection()  # 2 picked in the model
deconstruct = List.Deconstruct(list=select_model_elements@L2, lacing=Longest)
geometry = Element.Geometry(element=deconstruct.first)
centroid = Solid.Centroid(solid=geometry)
elementType = Element.ElementType(element=all_elements_of_category)
uniqueItems = List.UniqueItems(list=elementType)
boolean = BoolSelector(false)
clean = List.Clean(list=uniqueItems, preserveIndices=boolean)
code_block_2 = CodeBlock { "Width"; }
getParameterValueByName = Element.GetParameterValueByName(element=clean, parameterName=code_block_2)
code_block_3 = CodeBlock { 0.900; }
eq = Equals(x=getParameterValueByName, y=code_block_3)
filterByBoolMask = List.FilterByBoolMask(list=clean, mask=eq)
name = Element.Name(element=filterByBoolMask.in)
sortByKey = List.SortByKey(list=filterByBoolMask.in, keys=name)
watch_2 = Watch(sortByKey.sorted_list)
count = List.Count(list=watch_2)
code_block_4 = CodeBlock { 3; }
code_block_5 = CodeBlock(COUNT=count, SPACING=code_block_4) { (COUNT-1)*(SPACING*-1); (COUNT-1); }
translate = Geometry.Translate(geometry=centroid, xTranslation=code_block_5.out0)
byStartPointEndPoint = Line.ByStartPointEndPoint(startPoint=centroid, endPoint=translate)
pointsAtEqualSegmentLength = Curve.PointsAtEqualSegmentLength(curve=byStartPointEndPoint, divisions=code_block_5.out1)
legend_settings = Custom[Legend Settings]()  # package archi-lab.net; This node sets all settings for the Legend display with Analysis Visualization Framework of Revit.; unwired: showLegend, showUnits, showName, headingTextTypeId, bodyTextTypeId, showDataDescription, rounding, graphHeight, graphWidth, graphSteps
code_block_6 = CodeBlock { "Test Drafting View"; }
byName = DraftingView.ByName(name=code_block_6)
ʳʰʸᵗʰᵐ_viewport_create = Rhythm.Revit.Elements.Viewport.Create()  # unwired: sheet, view, location
legend_settings_2 = Custom[Legend Settings]()  # unwired: showLegend, showUnits, showName, headingTextTypeId, bodyTextTypeId, showDataDescription, rounding, graphHeight, graphWidth, graphSteps
legend_position_types = LegendPositionTypesUi()  # nothing selected
code_block_7 = CodeBlock { "000_TEST"; }
